# Dynamo graph Dynamo_import_excel_to_Revit.dyn (Dynamo 2.0.1.5055)

file_path = Filename(".\Grid_Layout.xlsx")  # graph input
fromPath = FileObject(path=file_path)  # "File.FromPath"
code_block = CodeBlock { "Grid"; }
boolean = BoolSelector(true)  # graph input
importExcel = Data.ImportExcel(file=fromPath, sheetName=code_block, readAsStrings=boolean)
number = DoubleInput(1)  # graph input
dropItems = List.DropItems(list=importExcel, amount=number)
transpose = List.Transpose(lists=dropItems)
code_block_2 = CodeBlock { [1,2,3,4,5,6]; }
getItemAtIndex = List.GetItemAtIndex(list=transpose, index=code_block_2)
number_2 = DoubleInput(0)  # graph input
getItemAtIndex_2 = List.GetItemAtIndex(list=getItemAtIndex, index=number_2)
toNumber = String.ToNumber(str=getItemAtIndex_2)
number_3 = DoubleInput(1)  # graph input
getItemAtIndex_3 = List.GetItemAtIndex(list=getItemAtIndex, index=number_3)
toNumber_2 = String.ToNumber(str=getItemAtIndex_3)
number_4 = DoubleInput(2)  # graph input
getItemAtIndex_4 = List.GetItemAtIndex(list=getItemAtIndex, index=number_4)
toNumber_3 = String.ToNumber(str=getItemAtIndex_4)
byCoordinates = Point.ByCoordinates(x=toNumber, y=toNumber_2, z=toNumber_3)
number_5 = DoubleInput(3)  # graph input
getItemAtIndex_5 = List.GetItemAtIndex(list=getItemAtIndex, index=number_5)
toNumber_4 = String.ToNumber(str=getItemAtIndex_5)
number_6 = DoubleInput(4)  # graph input
getItemAtIndex_6 = List.GetItemAtIndex(list=getItemAtIndex, index=number_6)
toNumber_5 = String.ToNumber(str=getItemAtIndex_6)
number_7 = DoubleInput(5)  # graph input
getItemAtIndex_7 = List.GetItemAtIndex(list=getItemAtIndex, index=number_7)
toNumber_6 = String.ToNumber(str=getItemAtIndex_7)
byCoordinates_2 = Point.ByCoordinates(x=toNumber_4, y=toNumber_5, z=toNumber_6)
byStartPointEndPoint = Grid.ByStartPointEndPoint(start=byCoordinates, end=byCoordinates_2)
code_block_3 = CodeBlock { "Name"; }
firstItem = List.FirstItem(list=transpose)
setParameterByName = Element.SetParameterByName(element=byStartPointEndPoint, parameterName=code_block_3, value=firstItem)
family_types = FamilyTypes(index=2)
code_block_4 = CodeBlock { "Column"; }
boolean_2 = BoolSelector(true)
importExcel_2 = Data.ImportExcel(file=fromPath, sheetName=code_block_4, readAsStrings=boolean_2)
number_8 = DoubleInput(1)
dropItems_2 = List.DropItems(list=importExcel_2, amount=number_8)
transpose_2 = List.Transpose(lists=dropItems_2)
code_block_5 = CodeBlock { 1; }
getItemAtIndex_8 = List.GetItemAtIndex(list=transpose_2, index=code_block_5)
toNumber_7 = String.ToNumber(str=getItemAtIndex_8)
code_block_6 = CodeBlock { 2; }
getItemAtIndex_9 = List.GetItemAtIndex(list=transpose_2, index=code_block_6)
toNumber_8 = String.ToNumber(str=getItemAtIndex_9)
code_block_7 = CodeBlock { 3; }
getItemAtIndex_10 = List.GetItemAtIndex(list=transpose_2, index=code_block_7)
toNumber_9 = String.ToNumber(str=getItemAtIndex_10)
byCoordinates_3 = Point.ByCoordinates(x=toNumber_7, y=toNumber_8, z=toNumber_9)
levels = Levels()  # nothing selected
byPointAndLevel = FamilyInstance.ByPointAndLevel(familyType=family_types, point=byCoordinates_3, level=levels)
code_block_8 = CodeBlock { 10.0; }
code_block_9 = CodeBlock { "Level 2"; }
byElevationAndName = Level.ByElevationAndName(elevation=code_block_8, name=code_block_9)
code_block_10 = CodeBlock { "Beam"; }
boolean_3 = BoolSelector(true)
importExcel_3 = Data.ImportExcel(file=fromPath, sheetName=code_block_10, readAsStrings=boolean_3)
number_9 = DoubleInput(1)
dropItems_3 = List.DropItems(list=importExcel_3, amount=number_9)
transpose_3 = List.Transpose(lists=dropItems_3)
code_block_11 = CodeBlock { 1; }
getItemAtIndex_11 = List.GetItemAtIndex(list=transpose_3, index=code_block_11)
toNumber_10 = String.ToNumber(str=getItemAtIndex_11)
code_block_12 = CodeBlock { 2; }
getItemAtIndex_12 = List.GetItemAtIndex(list=transpose_3, index=code_block_12)
toNumber_11 = String.ToNumber(str=getItemAtIndex_12)
code_block_13 = CodeBlock { 3; }
getItemAtIndex_13 = List.GetItemAtIndex(list=transpose_3, index=code_block_13)
toNumber_12 = String.ToNumber(str=getItemAtIndex_13)
byCoordinates_4 = Point.ByCoordinates(x=toNumber_10, y=toNumber_11, z=toNumber_12)
code_block_14 = CodeBlock { 4; }
getItemAtIndex_14 = List.GetItemAtIndex(list=transpose_3, index=code_block_14)
toNumber_13 = String.ToNumber(str=getItemAtIndex_14)
code_block_15 = CodeBlock { 5; }
getItemAtIndex_15 = List.GetItemAtIndex(list=transpose_3, index=code_block_15)
toNumber_14 = String.ToNumber(str=getItemAtIndex_15)
code_block_16 = CodeBlock { 6; }
getItemAtIndex_16 = List.GetItemAtIndex(list=transpose_3, index=code_block_16)
toNumber_15 = String.ToNumber(str=getItemAtIndex_16)
byCoordinates_5 = Point.ByCoordinates(x=toNumber_13, y=toNumber_14, z=toNumber_15)
byStartPointEndPoint_2 = Line.ByStartPointEndPoint(startPoint=byCoordinates_4, endPoint=byCoordinates_5)
levels_2 = Levels()  # nothing selected
family_types_2 = FamilyTypes(index=10)
beamByCurve = StructuralFraming.BeamByCurve(curve=byStartPointEndPoint_2, level=levels_2, structuralFramingType=family_types_2)
